% Simulink data dictionary project_params.sldd

MIN_SEP_KM = Simulink.Parameter(0.5)
T_MAX = Simulink.Parameter(100)
AIRCRAFT1_START = Simulink.Parameter([0 0])
AIRCRAFT1_GOAL = Simulink.Parameter([0 8])
AIRCRAFT2_START = Simulink.Parameter([-3 4])
AIRCRAFT2_GOAL = Simulink.Parameter([3 4])