# Requirement set aircraft_reqs (R2024a)

## 1 [R-1] Aircraft moves at constant speed of 1km/h along axes.

## 2 [R-2] Heading changes only in ±90° steps at decision ticks; no 180° reversal.

## 3 [R-3] Never allow another aircraft into your “danger” square.

## 4 [R-4] Use comms only when the other aircraft is inside the “communication” square.

## 5 [R-5] Reach destination (time-optimal subject to R-3/R-4).

## 6 [R-6] Provide 2D plots of flown paths; deliver coverage & test evidence.