test file "aircraft_tests"

suite "Black Box"

  case "Side Collision 1" [baseline]
    description: Aircraft1 moving up. Aircraft2 moving left. Side collision must be avoided.
    model aircraft_arch, stop time 100
    parameter set "Parameter Set 1":
      AIRCRAFT1_GOAL = [0 0]  % project_params.sldd
      AIRCRAFT1_START = [0 10]  % project_params.sldd
      AIRCRAFT2_GOAL = [5 5]  % project_params.sldd
      AIRCRAFT2_START = [-5 5]  % project_params.sldd
      T_MAX = 100  % project_params.sldd

  case "Side Collision 2" [baseline]
    description: Aircraft1 moving down. Aircraft2 moving left. Side collision must be avoided.
    model aircraft_arch, stop time 100
    parameter set "Parameter Set 1":
      AIRCRAFT1_GOAL = [0 10]  % project_params.sldd
      AIRCRAFT1_START = [0 0]  % project_params.sldd
      AIRCRAFT2_GOAL = [5 5]  % project_params.sldd
      AIRCRAFT2_START = [-5 5]  % project_params.sldd
      T_MAX = 100  % project_params.sldd

  case "Side Collision 3" [baseline]
    description: Aircraft1 moving up. Aircraft2 moving right. Side collision must be avoided.
    model aircraft_arch, stop time 100
    parameter set "Parameter Set 1":
      AIRCRAFT1_GOAL = [0 0]  % project_params.sldd
      AIRCRAFT1_START = [0 10]  % project_params.sldd
      AIRCRAFT2_GOAL = [-5 5]  % project_params.sldd
      AIRCRAFT2_START = [5 5]  % project_params.sldd
      T_MAX = 100  % project_params.sldd

  case "Side Collision 4" [baseline]
    description: Aircraft1 moving down. Aircraft2 moving right. Side collision must be avoided.
    model aircraft_arch, stop time 100
    parameter set "Parameter Set 1":
      AIRCRAFT1_GOAL = [0 10]  % project_params.sldd
      AIRCRAFT1_START = [0 0]  % project_params.sldd
      AIRCRAFT2_GOAL = [-5 5]  % project_params.sldd
      AIRCRAFT2_START = [5 5]  % project_params.sldd
      T_MAX = 100  % project_params.sldd

  case "Head On Collision 1" [baseline]
    description: Aircraft1 moving right. Aircraft2 moving left. Head on collision must be avoided.
    model aircraft_arch, stop time 100
    parameter set "Parameter Set 1":
      AIRCRAFT1_GOAL = [0 0]  % project_params.sldd
      AIRCRAFT1_START = [10 0]  % project_params.sldd
      AIRCRAFT2_GOAL = [10 0]  % project_params.sldd
      AIRCRAFT2_START = [0 0]  % project_params.sldd
      T_MAX = 100  % project_params.sldd

  case "Head On Collision 2" [baseline]
    description: Aircraft1 moving left. Aircraft2 moving right. Head on collision must be avoided.
    model aircraft_arch, stop time 100
    parameter set "Parameter Set 1":
      AIRCRAFT1_GOAL = [10 0]  % project_params.sldd
      AIRCRAFT1_START = [0 0]  % project_params.sldd
      AIRCRAFT2_GOAL = [0 0]  % project_params.sldd
      AIRCRAFT2_START = [10 0]  % project_params.sldd
      T_MAX = 100  % project_params.sldd

  case "Head Butt Collision 1" [baseline]
    description: Aircraft1 moving left. Aircraft2 moving right. Head on collision must be avoided.
    model aircraft_arch, stop time 100
    parameter set "Parameter Set 1":
      AIRCRAFT1_GOAL = [0 0]  % project_params.sldd
      AIRCRAFT1_START = [0 8]  % project_params.sldd
      AIRCRAFT2_GOAL = [-3 4]  % project_params.sldd
      AIRCRAFT2_START = [3 4]  % project_params.sldd
      T_MAX = 100  % project_params.sldd

  case "Head Butt Collision 2" [baseline]
    description: Aircraft1 moving left. Aircraft2 moving right. Head on collision must be avoided.
    model aircraft_arch, stop time 100
    parameter set "Parameter Set 1":
      AIRCRAFT1_GOAL = [0 8]  % project_params.sldd
      AIRCRAFT1_START = [0 0]  % project_params.sldd
      AIRCRAFT2_GOAL = [-3 4]  % project_params.sldd
      AIRCRAFT2_START = [3 4]  % project_params.sldd
      T_MAX = 100  % project_params.sldd

  case "Head Butt Collision 3" [baseline]
    description: Aircraft1 moving left. Aircraft2 moving right. Head on collision must be avoided.
    model aircraft_arch, stop time 100
    parameter set "Parameter Set 1":
      AIRCRAFT1_GOAL = [0 0]  % project_params.sldd
      AIRCRAFT1_START = [0 8]  % project_params.sldd
      AIRCRAFT2_GOAL = [3 4]  % project_params.sldd
      AIRCRAFT2_START = [-3 4]  % project_params.sldd
      T_MAX = 100  % project_params.sldd

  case "Head Butt Collision 4" [baseline]
    description: Aircraft1 moving left. Aircraft2 moving right. Head on collision must be avoided.
    model aircraft_arch, stop time 100
    parameter set "Parameter Set 1":
      AIRCRAFT1_GOAL = [0 8]  % project_params.sldd
      AIRCRAFT1_START = [0 0]  % project_params.sldd
      AIRCRAFT2_GOAL = [3 4]  % project_params.sldd
      AIRCRAFT2_START = [-3 4]  % project_params.sldd
      T_MAX = 100  % project_params.sldd